# Dynamo graph CLOUD - Floor from Point Cloud.dyn (Dynamo 2.1.0.7500)

# group: RESET
create_a_floor_by_window = BoolSelector(true)  # "Create a Floor by window-selecting Point Cloud Points. RESET"; graph input

# group: Adjust for units
boolean = BoolSelector(true)
python_script = Python(IN[0]=boolean)
# ---------- python_script.python (16 lines) ----------
import clr

clr.AddReference('RevitAPI')
from Autodesk.Revit.DB import *

clr.AddReference('RevitServices')
import RevitServices
from RevitServices.Persistence import DocumentManager
from RevitServices.Transactions import TransactionManager

doc = DocumentManager.Instance.CurrentDBDocument

unittype = UnitType.UT_Length
formatoptions = doc.GetUnits().GetFormatOptions(unittype)
dispunits = formatoptions.DisplayUnits
OUT = str(dispunits)
# ----------------------------------------
code_block = CodeBlock()
# ---------- code_block.designscript (3 lines) ----------
["Feet",
"Inches"];
true;
# ----------------------------------------
contains = String.Contains(str=python_script, searchFor=code_block.out0, ignoreCase=code_block.out1)
countTrue = List.CountTrue(list=contains)
code_block_2 = CodeBlock(n=countTrue)
# ---------- code_block_2.designscript (3 lines) ----------
n > 0?
1:
0;
# ----------------------------------------

# group: Special thanks to Ewan_Opie of Sastrugi for creating this method!
code_block_3 = CodeBlock { Refresh:bool=false; }
python_script_2 = Python(IN[0]=create_a_floor_by_window)
# ---------- python_script_2.python (11 lines) ----------
import clr

clr.AddReference("RevitServices")
import RevitServices
from RevitServices.Persistence import DocumentManager
doc = DocumentManager.Instance.CurrentDBDocument
clr.AddReference("RevitNodes")
import Revit
clr.ImportExtensions(Revit.Elements)

OUT = doc.ActiveView.ToDSType(True)
# ----------------------------------------
firstItem = List.FirstItem(list=python_script_2)
python_script_3 = Python(IN[0]=create_a_floor_by_window, IN[1]=firstItem, IN[2]=code_block_2)
# ---------- python_script_3.python (56 lines) ----------
# Python coding credit to Dynamo Forum user - @Ewan_Opie 2019
# Sastrugi Package https://sites.google.com/view/sastrugi/home

import clr
clr.AddReference('RevitAPI')
import Autodesk
from Autodesk.Revit.DB import *

clr.AddReference("RevitServices")
import RevitServices
from RevitServices.Persistence import DocumentManager

clr.AddReference("RevitAPIUI")
from  Autodesk.Revit.UI import *

clr.AddReference('ProtoGeometry')
from Autodesk.DesignScript.Geometry import *

clr.AddReference('DSCoreNodes') 
import DSCore
from DSCore import *

clr.AddReference("RevitNodes")
import Revit
clr.ImportExtensions(Revit.GeometryConversion)

doc = DocumentManager.Instance.CurrentDBDocument
uidoc=DocumentManager.Instance.CurrentUIApplication.ActiveUIDocument

buttonlist = TaskDialogCommonButtons.Ok
TaskDialog.Show("Sastrugi","Please select a region, bottom left to top right.",buttonlist)

pboxS=Autodesk.Revit.UI.Selection.PickBoxStyle.Enclosing
pickedBox = uidoc.Selection.PickBox(pboxS, "Select a box")
minP = UnwrapElement(pickedBox.Min)
maxP = UnwrapElement(pickedBox.Max)

if IN[2]==0:
	p1=Point.ByCoordinates(minP.X*304.8,minP.Y*304.8,minP.Z*304.8)
	p2=Point.ByCoordinates(maxP.X*304.8,maxP.Y*304.8,maxP.Z*304.8)
else:
	p1=Point.ByCoordinates(minP.X,minP.Y,minP.Z)
	p2=Point.ByCoordinates(maxP.X,maxP.Y,maxP.Z)

aView = UnwrapElement(IN[1])

aVO = aView.Origin.ToPoint()
aVD = aView.ViewDirection.ToVector()
aVP = Plane.ByOriginNormal(aVO,aVD)

rL = Line.ByStartPointEndPoint(p1,p2)
rLaVP = Curve.PullOntoPlane(rL,aVP)

newO = Curve.PointAtParameter(rLaVP,0.5)

OUT = aVP,rLaVP,newO,aView
# ----------------------------------------
code_block_4 = CodeBlock(passthrough=create_a_floor_by_window, waitfor=python_script_3) { [passthrough,waitfor][0]; }
python_script_4 = Python(IN[0]=code_block_4)
# ---------- python_script_4.python (40 lines) ----------
import clr

clr.AddReference("RevitAPIUI")
from  Autodesk.Revit.UI import *

clr.AddReference("RevitServices")
import RevitServices
from RevitServices.Persistence import DocumentManager
doc = DocumentManager.Instance.CurrentDBDocument
uidoc=DocumentManager.Instance.CurrentUIApplication.ActiveUIDocument

clr.AddReference("RevitNodes")
import Revit
clr.ImportExtensions(Revit.Elements)

def flatten(*args):
    for x in args:
        if hasattr(x, '__iter__'):
            for y in flatten(*x):
                yield y
        else:
            yield x

sel1 = uidoc.Selection
ot1 = Selection.ObjectType.Element
msg = 'Pick PointCloud in Active View.'
TaskDialog.Show("Sastrugi", msg)
el_refs = sel1.PickObject(ot1, "Select")
typelist = list()
idlist = list()
el_ref = flatten(el_refs)
for i in el_ref:

	try:
		typelist.append(doc.GetElement(i.ElementId))
	except:
		typelist.apped(list())
		

OUT = typelist[-1]
# ----------------------------------------
code_block_5 = CodeBlock(out=python_script_3) { out[0]; out[1]; out[2]; out[3]; }
ZAxis = Vector.ZAxis()
code_block_6 = CodeBlock { 1000; }
translate = Geometry.Translate(geometry=code_block_5.out2, direction=ZAxis, distance=code_block_6)
normal = Plane.Normal(plane=code_block_5.out0)
translate_2 = Geometry.Translate(geometry=code_block_5.out2, direction=normal, distance=code_block_6)
byThreePoints = Plane.ByThreePoints(origin=code_block_5.out2, planePoint=translate, xAxisPoint=translate_2)
YAxis = Plane.YAxis(plane=code_block_5.out0)
byOriginNormal = Plane.ByOriginNormal(origin=code_block_5.out2, normal=YAxis)
code_block_7 = CodeBlock(planecheck=byThreePoints, usethisone=byOriginNormal, usetheotherone=byThreePoints)
# ---------- code_block_7.designscript (3 lines) ----------
planecheck==null?
usethisone:
usetheotherone;
# ----------------------------------------
mirror = Geometry.Mirror(geometry=code_block_5.out1, mirrorPlane=code_block_7)
code_block_8 = CodeBlock { 0..1; }
pointAtParameter = Curve.PointAtParameter(curve=mirror, param=code_block_8)
pointAtParameter_2 = Curve.PointAtParameter(curve=code_block_5.out1, param=code_block_8)
create = List.Create(item0=pointAtParameter, item1=pointAtParameter_2)
transpose = List.Transpose(lists=create)
flatten = List.Flatten(list=transpose)
byCornerPoints = Rectangle.ByCornerPoints(points=flatten)
reverse = Vector.Reverse(vector=normal)
center = Polygon.Center(polygon=byCornerPoints)
boundingBox = Element.BoundingBox(element=python_script_4)
toCuboid = BoundingBox.ToCuboid(boundingBox=boundingBox)
code_block_9 = CodeBlock(e=toCuboid) { e.Faces; }
vertices = Face.Vertices(face=code_block_9)
pointGeometry = Vertex.PointGeometry(vertex=vertices)
byPerimeterPoints = Surface.ByPerimeterPoints(points=pointGeometry)
project = Point.Project(point=center, baseGeometry=byPerimeterPoints, projectionDirection=normal, lacing=Longest)
project_2 = Point.Project(point=center, baseGeometry=byPerimeterPoints, projectionDirection=reverse, lacing=Longest)
join = List.Join(list0=project, list1=project_2)
flatten_2 = List.Flatten(list=join)
code_block_10 = CodeBlock { false; }
clean = List.Clean(list=flatten_2, preserveIndices=code_block_10)
distanceTo = Geometry.DistanceTo(geometry=center, other=clean)
maximumItem = List.MaximumItem(list=distanceTo)
code_block_11 = CodeBlock(dist=maximumItem) { dist*2; }
translate_3 = Geometry.Translate(geometry=byCornerPoints, direction=reverse, distance=code_block_11)
points = Polygon.Points(polygon=translate_3)
deconstruct = List.Deconstruct(list=points)
create_2 = List.Create(item0=deconstruct.rest, item1=deconstruct.first)
flatten_3 = List.Flatten(list=create_2)
points_2 = Polygon.Points(polygon=byCornerPoints)
create_3 = List.Create(item0=points, item1=points_2)
transpose_2 = List.Transpose(lists=create_3)
addItemToEnd = List.AddItemToEnd(item=flatten_3@L1, list=transpose_2@L2)
byBestFitThroughPoints = Plane.ByBestFitThroughPoints(points=addItemToEnd)
code_block_12 = CodeBlock(passthrough=python_script_4, waitfor=byBestFitThroughPoints) { [passthrough,waitfor][0]; }
code_block_13 = CodeBlock(list=code_block_12) { Flatten([list]); }
firstItem_2 = List.FirstItem(list=code_block_13)
code_block_14 = CodeBlock { 0.001; }
code_block_15 = CodeBlock()
# ---------- code_block_15.designscript (6 lines) ----------
//This is the number of points to take
//from within the selected region.
//Please note that the actual number of
//Points output may vary from this
//number if a Sectionbox has been used.
PointSampleSize: int = 1000;
# ----------------------------------------
python_script_5 = Python(IN[0]=firstItem_2, IN[1]=byBestFitThroughPoints, IN[2]=code_block_14, IN[3]=code_block_15)
# ---------- python_script_5.python (46 lines) ----------
import clr
clr.AddReference('ProtoGeometry')
from Autodesk.DesignScript.Geometry import *

clr.AddReference("RevitNodes")
import Revit
clr.ImportExtensions(Revit.Elements)

clr.ImportExtensions(Revit.GeometryConversion)

clr.AddReference("RevitServices")
import RevitServices
from RevitServices.Persistence import DocumentManager
from RevitServices.Transactions import TransactionManager
from System.Collections.Generic import *

clr.AddReference("RevitAPI")
import Autodesk
from Autodesk.Revit.DB import *
from Autodesk.Revit.DB.PointClouds import *


doc = DocumentManager.Instance.CurrentDBDocument
uiapp = DocumentManager.Instance.CurrentUIApplication
app = uiapp.Application
uidoc=DocumentManager.Instance.CurrentUIApplication.ActiveUIDocument

planes=[]
for i in IN[1]:
	planes.append(UnwrapElement(i).ToPlane())
Iplanes=List[Autodesk.Revit.DB.Plane](planes)

pcf=PointCloudFilterFactory.CreateMultiPlaneFilter(planes)

averageDistance = IN[2]
numberOfPoints= IN[3]

points = UnwrapElement(IN[0]).GetPoints(pcf, averageDistance, numberOfPoints)
elements=[]
for p in points:
	X=p.X
	Y=p.Y
	Z=p.Z
	elements.append(Point.Create(XYZ(X,Y,Z)).ToProtoType(True))

OUT = elements
# ----------------------------------------
code_block_16 = CodeBlock(list=python_script_5) { Flatten([list]); }

# group: Fix for rotated cloud instance
python_script_6 = Python(IN[0]=code_block_13)
# ---------- python_script_6.python (49 lines) ----------
#BIG THANKS TO @AWILLIAMS

import clr
clr.AddReference('ProtoGeometry')
from Autodesk.DesignScript.Geometry import *

clr.AddReference("RevitNodes")
import Revit
clr.ImportExtensions(Revit.Elements)

clr.AddReference("RevitServices")
import RevitServices
from RevitServices.Persistence import DocumentManager
from RevitServices.Transactions import TransactionManager

from System.Collections.Generic import *

clr.AddReference("RevitAPI")
import Autodesk
from Autodesk.Revit.DB import *

clr.ImportExtensions(Revit.GeometryConversion)

doc = DocumentManager.Instance.CurrentDBDocument
uiapp = DocumentManager.Instance.CurrentUIApplication
app = uiapp.Application


cloud = UnwrapElement(IN[0])

TransactionManager.Instance.EnsureInTransaction(doc)


cloudtransform = []

for c in cloud:
	transform = c.GetTotalTransform()
	X = transform.Origin.X
	Y = transform.Origin.Y
	Z = transform.Origin.Z
	bX = transform.BasisX.ToVector()
	bY = transform.BasisY.ToVector()
	point = Point.Create(XYZ(X,Y,Z)).ToProtoType(True)
	cloudtransform.append(point)
	cloudtransform.append(bX)
		
TransactionManager.Instance.TransactionTaskDone()

OUT = cloudtransform
# ----------------------------------------
code_block_17 = CodeBlock(p=python_script_6) { p[0]; p[1]; }
ZAxis_2 = Vector.ZAxis()
XAxis = Vector.XAxis()
angleWithVector = Vector.AngleWithVector(vector=code_block_17.out1, otherVector=XAxis)

# group: Adjust Selected Points by Transform and Section Box Containment (CREDIT TO @Awilliams for Boundingbox code)
byBestFitThroughPoints_2 = Plane.ByBestFitThroughPoints()  # unwired: points
code_block_18 = CodeBlock(BestFitPlane=byBestFitThroughPoints_2) { BestFitPlane; }
python_script_7 = Python(IN[0]=create_a_floor_by_window)  # same code as python_script_2
code_block_19 = CodeBlock { "Section Box"; }
getParameterValueByName = Element.GetParameterValueByName(element=python_script_7, parameterName=code_block_19)
elementType = Element.ElementType(element=code_block_12)
code_block_20 = CodeBlock { "Scale"; }
getParameterValueByName_2 = Element.GetParameterValueByName(element=elementType, parameterName=code_block_20)
scale = Geometry.Scale(geometry=code_block_16, xamount=getParameterValueByName_2, yamount=getParameterValueByName_2, zamount=getParameterValueByName_2)
identity = CoordinateSystem.Identity()
ZAxis_3 = Vector.ZAxis()
byOriginNormal_2 = Plane.ByOriginNormal(origin=code_block_17.out0, normal=ZAxis_3)
code_block_21 = CodeBlock { false; }

# group (continued): Fix for rotated cloud instance
rotate = Geometry.Rotate(geometry=byOriginNormal_2, origin=code_block_17.out0, axis=ZAxis_2, degrees=angleWithVector)

# group (continued): Adjust Selected Points by Transform and Section Box Containment (CREDIT TO @Awilliams for Boundingbox code)
byPlane = CoordinateSystem.ByPlane(plane=rotate)
transform = Geometry.Transform(geometry=scale, fromCoordinateSystem=identity, contextCoordinateSystem=byPlane, lacing=Longest)

# group: Section box to cuboid with Rotation
code_block_22 = CodeBlock(list=python_script_7) { Flatten([list]); }
python_script_8 = Python(IN[0]=code_block_22)
# ---------- python_script_8.python (60 lines) ----------
#BIG THANKS TO @AWILLIAMS

import clr
clr.AddReference('ProtoGeometry')
from Autodesk.DesignScript.Geometry import *

clr.AddReference("RevitNodes")
import Revit
clr.ImportExtensions(Revit.Elements)

clr.AddReference("RevitServices")
import RevitServices
from RevitServices.Persistence import DocumentManager
from RevitServices.Transactions import TransactionManager

from System.Collections.Generic import *

clr.AddReference("RevitAPI")
import Autodesk
from Autodesk.Revit.DB import *

clr.ImportExtensions(Revit.GeometryConversion)

doc = DocumentManager.Instance.CurrentDBDocument
uiapp = DocumentManager.Instance.CurrentUIApplication
app = uiapp.Application


views = UnwrapElement(IN[0])

TransactionManager.Instance.EnsureInTransaction(doc)

sectionboxes = []

for view in views:
	sectionbox = view.GetSectionBox()
	transform = sectionbox.Transform
	sboxoriginx = transform.Origin.X
	sboxoriginy = transform.Origin.Y
	sboxoriginz = transform.Origin.Z
	vx = transform.BasisX.ToVector()
	bp = Point.Create(XYZ(sboxoriginx,sboxoriginy,sboxoriginz)).ToProtoType(True)
	minx = sectionbox.Min.X + sboxoriginx
	maxx = sectionbox.Max.X + sboxoriginx
	miny = sectionbox.Min.Y + sboxoriginy
	maxy = sectionbox.Max.Y + sboxoriginy
	minz = sectionbox.Min.Z + sboxoriginz
	maxz = sectionbox.Max.Z + sboxoriginz
	bbox = BoundingBoxXYZ()
	bbox.Min = XYZ((minx), (miny), (minz))
	bbox.Max = XYZ((maxx), (maxy), (maxz))
	tsectionbox = bbox.ToProtoType()
	sectionboxes.append(tsectionbox)
	sectionboxes.append(vx)
	sectionboxes.append(bp)

	
TransactionManager.Instance.TransactionTaskDone()

OUT = sectionboxes
# ----------------------------------------
code_block_23 = CodeBlock(p=python_script_8) { p[0]; p[1]; p[2]; }
toCuboid_2 = BoundingBox.ToCuboid(boundingBox=code_block_23.out0)
ZAxis_4 = Vector.ZAxis()
YAxis_2 = Vector.YAxis()
angleWithVector_2 = Vector.AngleWithVector(vector=code_block_23.out1, otherVector=YAxis_2)
XAxis_2 = Vector.XAxis()
angleWithVector_3 = Vector.AngleWithVector(vector=code_block_23.out1, otherVector=XAxis_2)
code_block_24 = CodeBlock(v=angleWithVector_2, this1=angleWithVector_3)
# ---------- code_block_24.designscript (3 lines) ----------
v>90?
0-this1:
this1;
# ----------------------------------------
rotate_2 = Geometry.Rotate(geometry=toCuboid_2, origin=code_block_23.out2, axis=ZAxis_4, degrees=code_block_24)

doesIntersect = Geometry.DoesIntersect(geometry=transform, other=rotate_2)

# group (continued): Adjust Selected Points by Transform and Section Box Containment (CREDIT TO @Awilliams for Boundingbox code)
filterByBoolMask = List.FilterByBoolMask(list=transform, mask=doesIntersect)
create_4 = List.Create(item0=filterByBoolMask.in, item1=filterByBoolMask.out)
code_block_25 = CodeBlock(list=create_4) { Flatten([list]); }
clean_2 = List.Clean(list=code_block_25, preserveIndices=code_block_21)
code_block_26 = CodeBlock(section=getParameterValueByName, result1=clean_2, result2=filterByBoolMask.in)
# ---------- code_block_26.designscript (3 lines) ----------
section==0?
result1:
result2;
# ----------------------------------------
code_block_27 = CodeBlock(list=code_block_26) { Flatten([list]); }

code_block_28 = CodeBlock { 5; 100; }
pointcloud_ransac_plane = Custom[❄_Pointcloud RANSAC Plane Detection](Points_var=code_block_27, Iterations=code_block_28.out0, Distance=code_block_28.out1, Threshold=code_block_28.out1)  # (Sastrugi_Pointcloud_Geometry) This node uses Random sample consensus (RANSAC) to determine planes within Pointclouds and groups point-sets based on these planes.
flatten_4 = List.Flatten(list=pointcloud_ransac_plane.PointSets)
add_sub_elements_points_to_the = BoolSelector(true)  # "Add Sub Elements (Points) to the Floor from the Point Cloud? (False will create a simple approximation, True will create a more realistic Floor)"; graph input
byGeometry = BoundingBox.ByGeometry(geom=pointcloud_ransac_plane.PointSets)
toCuboid_3 = BoundingBox.ToCuboid(boundingBox=byGeometry)
explode = Geometry.Explode(geometry=toCuboid_3)
flatten_5 = List.Flatten(list=explode)
area = Surface.Area(surface=flatten_5)
maximumItem_2 = List.MaximumItem(list=area)
indexOf = List.IndexOf(list=area, element=maximumItem_2)
getItemAtIndex = List.GetItemAtIndex(list=flatten_5, index=indexOf)
deconstructSurface = Geometry.Surfaces.DeconstructSurface(surface=getItemAtIndex)
select_floor_type = FloorTypes("Concrete Slab - 12\" Variable Thickness")  # graph input
floor_host_level = Levels("Level 1")  # graph input
byOutlineTypeAndLevel = Floor.ByOutlineTypeAndLevel(outlineCurves=deconstructSurface.Edges, floorType=select_floor_type, level=floor_host_level)
code_block_29 = CodeBlock { "Height Offset From Level"; }
code_block_30 = CodeBlock { 0; }
plane = Custom[Level.Plane](level=floor_host_level)  # Retrieves the plane of a given level
origin = Plane.Origin(plane=plane)
Z = Point.Z(point=origin)
byCoordinates = Point.ByCoordinates(x=code_block_30, y=code_block_30, z=Z)
origin_2 = Plane.Origin(plane=pointcloud_ransac_plane.Planes)
Z_2 = Point.Z(point=origin_2)
byCoordinates_2 = Point.ByCoordinates(x=code_block_30, y=code_block_30, z=Z_2)
byTwoPoints = Vector.ByTwoPoints(start=byCoordinates, end=byCoordinates_2)
Z_3 = Vector.Z(vector=byTwoPoints)
setParameterByName = Element.SetParameterByName(element=byOutlineTypeAndLevel, parameterName=code_block_29, value=Z_3)
code_block_31 = CodeBlock(in0=add_sub_elements_points_to_the, floor=setParameterByName) { in0 ? floor : 2; }
# note: Lacing: Longest
slabShapeByPoints = Custom[Floor.SlabShapeByPoints](points=flatten_4, floor=code_block_31, lacing=Longest)  # Transform a slab shape based on a list of Points
