# Dynamo graph Curve_Array_Placement.dyn (Dynamo 2.16.1.2727)

family_types = FamilyTypes()  # nothing selected; graph input
select_model_element = DSModelElementSelection()  # 1 picked in the model; graph input
curve = CurveElement.Curve(curveElement=select_model_element)
number_slider = DoubleSlider(8, range=8..20 step 1)  # graph input
pointsAtEqualSegmentLength = Curve.PointsAtEqualSegmentLength(curve=curve, divisions=number_slider)
byPoint = FamilyInstance.ByPoint(familyType=family_types, point=pointsAtEqualSegmentLength)
