# Dynamo graph Curve_Array_Placement_by_Distance.dyn (Dynamo 2.16.1.2727)
# packages: LunchBox for Dynamo 2016.11.11

family_types = FamilyTypes("RPC Tree - Conifer:12")  # graph input
reverse = BoolSelector(false)  # graph input
select_model_element = DSModelElementSelection()  # 1 picked in the model; graph input
curve = CurveElement.Curve(curveElement=select_model_element)
number_slider = DoubleSlider(10, range=0..100 step 0.1)  # graph input
divideCurveByDistance = Geometry.Curves.DivideCurveByDistance(curve=curve, Distance=number_slider)
reverse_2 = List.Reverse(list=divideCurveByDistance.Points)
if_ = RefactoredIf(test=reverse, true=reverse_2, false=divideCurveByDistance.Points)
byPoint = FamilyInstance.ByPoint(familyType=family_types, point=if_)
