# Dynamo graph DWG_To_Detail.dyn (Dynamo 2.16.1.2727)
# packages: Genius Loci 2022.9.16, bimorphNodes 4.2.4

file_path = Filename("..\..\..\Downloads\General CD Notes (1).dwg")  # graph input
drafting_view_name = StringInput("drafting_view")  # graph input
byName = DraftingView.ByName(name=drafting_view_name)
enumerate_dwg_import_options = Custom[Enumerate DWG import options]()  # package Genius Loci; Enumerate Color mode, Type of Placement and Type of Unit. Works with the "Link DWG" and "Import DWG" nodes.
code_block = CodeBlock(x=enumerate_dwg_import_options.Colormode) { x[2]; }
code_block_2 = CodeBlock(x=enumerate_dwg_import_options.Placement) { x[1]; }
code_block_3 = CodeBlock(x=enumerate_dwg_import_options.Unit) { x[0]; }
link_dwg = Custom[Link DWG](Filepaths=file_path, views=byName, Colormode=code_block, Placement=code_block_2, unit=code_block_3)  # package Genius Loci; Link DWGs in views with options. Use with the Enumerate DWG import options node. Based on a archilab's script.
detailCurvesFromCADLayers = CAD.DetailCurvesFromCADLayers(importInstance=link_dwg.ImportInstance, view=link_dwg.Views)
