# Dynamo graph DWG_To_Detail_and_Text.dyn (Dynamo 2.16.1.2727)
# packages: Genius Loci 2022.9.16, bimorphNodes 4.2.4, spring nodes 210.1.1

drafting_view_name = StringInput("drafting_view_all")  # graph input
byName = DraftingView.ByName(name=drafting_view_name)
file_path = Filename("..\..\..\Downloads\General CD Notes (1).dwg")  # graph input
enumerate_dwg_import_options = Custom[Enumerate DWG import options]()  # package Genius Loci; Enumerate Color mode, Type of Placement and Type of Unit. Works with the "Link DWG" and "Import DWG" nodes.
code_block = CodeBlock(x=enumerate_dwg_import_options.Colormode) { x[2]; }
code_block_2 = CodeBlock(x=enumerate_dwg_import_options.Placement) { x[1]; }
code_block_3 = CodeBlock(x=enumerate_dwg_import_options.Unit) { x[0]; }
link_dwg = Custom[Link DWG](Filepaths=file_path, views=byName, Colormode=code_block, Placement=code_block_2, unit=code_block_3)  # package Genius Loci; Link DWGs in views with options. Use with the Enumerate DWG import options node. Based on a archilab's script.
fromLayers = CADTextData.FromLayers(importInstance=link_dwg.ImportInstance)
originPoint = CADTextData.OriginPoint(cADTextData=fromLayers.CADTextData)
textValue = CADTextData.TextValue(cADTextData=fromLayers.CADTextData)
ꟿ_textnote_bypoint = Custom[ꟿ TextNote.ByPoint](view=byName, point=originPoint, content=textValue)  # package spring nodes; Places a text note at a given point in the view. View, text type and content can either be a single item for all points or the same length as the number of points. Set track to false if you'd like to place notes on every run.
detailCurvesFromCADLayers = CAD.DetailCurvesFromCADLayers(importInstance=link_dwg.ImportInstance, view=byName)
