# Dynamo graph DWG_To_Raw_TXT.dyn (Dynamo 2.16.1.2727)
# packages: Genius Loci 2022.9.16, bimorphNodes 4.2.4

file_path = Filename("..\..\..\Downloads\General CD Notes.dwg")  # graph input
drafting_view_name = StringInput("drafting_view_all_txt_2")  # graph input
byName = DraftingView.ByName(name=drafting_view_name)
enumerate_dwg_import_options = Custom[Enumerate DWG import options]()  # package Genius Loci; Enumerate Color mode, Type of Placement and Type of Unit. Works with the "Link DWG" and "Import DWG" nodes.
code_block = CodeBlock(x=enumerate_dwg_import_options.Colormode) { x[2]; }
code_block_2 = CodeBlock(x=enumerate_dwg_import_options.Placement) { x[1]; }
code_block_3 = CodeBlock(x=enumerate_dwg_import_options.Unit) { x[0]; }
link_dwg = Custom[Link DWG](Filepaths=file_path, views=byName, Colormode=code_block, Placement=code_block_2, unit=code_block_3)  # package Genius Loci; Link DWGs in views with options. Use with the Enumerate DWG import options node. Based on a archilab's script.
fromLayers = CADTextData.FromLayers(importInstance=link_dwg.ImportInstance)
textValue = CADTextData.TextValue(cADTextData=fromLayers.CADTextData)
flatten = List.Flatten(list=textValue)
directory_path = Directory("C:\Users\peter\Downloads")  # graph input
string = StringInput("text_notes_1")  # graph input
filenameToFilePaths = Custom[FilenameToFilePaths](DirectoryPath=directory_path, Filenames=string)  # package Genius Loci; Add directory and .pdf extension to filenames. Be careful with forbidden characters in filenames (* . " / \ : ;) For use with the "Remove Special Characters from String" node.
python_script = Python(IN[0]=flatten, IN[1]=filenameToFilePaths)  # CPython3
# ---------- python_script.python (20 lines) ----------
# Load the Python Standard and DesignScript Libraries
import sys
import clr
clr.AddReference('ProtoGeometry')
from Autodesk.DesignScript.Geometry import *

# The inputs to this node will be stored as a list in the IN variables.
text_strings = list(IN[0])
filepath = IN[1]


with open(f'{filepath}.txt', 'w') as f:
    for string in text_strings:
        f.write(string + '\n')

# Place your code below this line


# Assign your output to the OUT variable.
OUT = text_strings
# ----------------------------------------
