# Dynamo graph Family_Instance_Along_Path_Ellipse.dyn (Dynamo 2.13.1.3887)

code_block = CodeBlock { 1; }
integer_slider = IntegerSlider(7, range=0..100 step 1)  # graph input
div = code_block / integer_slider
family_types = FamilyTypes("Knoll_Studio_Bertoia_Side_Chair:Knoll_Studio_Bertoia_Side_Chair")  # graph input
select_model_element = DSModelElementSelection()  # 1 picked in the model; graph input
curves = Element.Curves(element=select_model_element)
pointsAtEqualChordLength = Curve.PointsAtEqualChordLength(curve=curves, divisions=integer_slider)
byPoint = FamilyInstance.ByPoint(familyType=family_types@L2, point=pointsAtEqualChordLength)
parameterAtPoint = Curve.ParameterAtPoint(curve=curves, point=pointsAtEqualChordLength)
code_block_2 = CodeBlock { -1; }
flatten = List.Flatten(list=parameterAtPoint, amount=code_block_2)
tangentAtParameter = Curve.TangentAtParameter(curve=curves, param=flatten@L1)
XAxis = Vector.XAxis()
angleWithVector = Vector.AngleWithVector(vector=tangentAtParameter, otherVector=XAxis)
code_block_3 = CodeBlock { 1; }
flatten_2 = List.Flatten(list=angleWithVector, amount=code_block_3)
rotation_correction = DoubleInput(0)  # graph input
python_script = Python(IN[0]=flatten_2, IN[1]=rotation_correction)  # CPython3
# ---------- python_script.python (25 lines) ----------
# Load the Python Standard and DesignScript Libraries
import sys
import clr
clr.AddReference('ProtoGeometry')
from Autodesk.DesignScript.Geometry import *

# The inputs to this node will be stored as a list in the IN variables.
vect_input = IN[0]
correction = IN[1]
vect_output = []
vect_check = []

for i in vect_input:
    if i not in vect_check:
        vect_check.append(i)
        temp_vect = i + correction
        vect_output.append(temp_vect)
    else:
        temp_vect = 360 - i
        vect_output.append(temp_vect)        

# Place your code below this line

# Assign your output to the OUT variable.
OUT = vect_output
# ----------------------------------------
setRotation = FamilyInstance.SetRotation(familyInstance=byPoint@L2, degree=python_script)
YAxis = Vector.YAxis()
