# Dynamo graph Mass_To_Topo.dyn (Dynamo 2.13.1.3887)

select_mass_element = DSModelElementSelection()  # 1 picked in the model; graph input
faces = Element.Faces(element=select_mass_element)
byJoinedSurfaces = PolySurface.ByJoinedSurfaces(surfaces=faces)
code_block = CodeBlock { 0..1..#10; }
pointAtParameter = Surface.PointAtParameter(surface=faces, u=code_block, v=code_block, lacing=CrossProduct)
intersect = Geometry.Intersect(geometry=byJoinedSurfaces, other=pointAtParameter, lacing=CrossProduct)

# group: Points on Edges
perimeterCurves = Surface.PerimeterCurves(surface=faces)
pointAtParameter_2 = Curve.PointAtParameter(curve=perimeterCurves, param=code_block, lacing=CrossProduct)
flatten = List.Flatten(list=pointAtParameter_2)

list_create = List.Create(item0=intersect, item1=flatten)
flatten_2 = List.Flatten(list=list_create)
pruneDuplicates = Point.PruneDuplicates(points=flatten_2)
byPoints = Topography.ByPoints(points=pruneDuplicates)
