# Dynamo graph Model_Lines_From_CAD.dyn "Model_Lines_From_CAD_Link" (Dynamo 2.13.1.3887)
# packages: bimorphNodes 4.2.1

select_model_elements = DSModelElementsSelection()  # 1 picked in the model; graph input
code_block = CodeBlock { true; }
curvesFromCADLayers = CAD.CurvesFromCADLayers(importInstance=select_model_elements, createModelCurves=code_block)
