# Dynamo graph Point_Cloud_To_Mesh.dyn (Dynamo 2.10.1.3976)
# packages: Orchid 260.1.0.7729

file_path = Filename("D:\3dscane\test\8.pts")
point_Cloud = Python(IN[0]=file_path)  # CPython3
# ---------- point_Cloud.python (92 lines) ----------
"""
Important! This code will only work with Dynamo versions
that are able to run cPython3 and have the following additional 
python packages installed.

Packages required:
numpy

"""

import random
import numpy as np
import clr
import open3d

#libraries used
import numpy as np
import open3d as o3d

clr.AddReference('ProtoGeometry')
from Autodesk.DesignScript.Geometry import *
import matplotlib.pyplot as plt


filepath=IN[0]


import numpy as np
import open3d as o3d


filepath=IN[0]
segment_models={}
segments={}
inliers={}
inlier_cloud={}

Outt=[]
Outt2=[]
Outt3=[]
dec_meshL=[]
max_plane_idx=1
point_cloud= np.loadtxt(filepath,skiprows=1)



#Format to open3d usable objects
pcd = o3d.geometry.PointCloud()


pcd.points = o3d.utility.Vector3dVector(point_cloud[:,:3])
pcd.colors = o3d.utility.Vector3dVector(point_cloud[:,3:6]/255)
pcd.normals = o3d.utility.Vector3dVector(point_cloud[:,6:9])


downpcd=pcd.voxel_down_sample(voxel_size=0.1)



labels1 = np.array(downpcd.cluster_dbscan(eps=0.05, min_points=10))
candidates1=[len(np.where(labels1==j)[0]) for j in np.unique(labels1)]
best_candidate1=int(np.unique(labels1)[np.where(candidates1== np.max(candidates1))[0]])

rest=downpcd.select_by_index(list(np.where(labels1== best_candidate1)[0]))    


    
    
distances = rest.compute_nearest_neighbor_distance()
avg_dist = np.mean(distances)
radius = 1 * avg_dist
    
    #computing the mehs

bpa_mesh = o3d.geometry.TriangleMesh.create_from_point_cloud_ball_pivoting(rest,o3d.utility.DoubleVector([1*radius, radius*2])) 
#dec_mesh1 = bpa_mesh.filter_smooth_simple(number_of_iterations=1)
dec_mesh1 = bpa_mesh.filter_smooth_taubin(number_of_iterations=10)
dec_mesh3=dec_mesh1
dec_mesh3.remove_degenerate_triangles()
dec_mesh3.remove_duplicated_triangles()
dec_mesh3.remove_duplicated_vertices()
dec_mesh3.remove_non_manifold_edges()
   # Outt.append(np.asarray(segments[i].Points).tolist())
Outt2.append(np.asarray(dec_mesh3.triangles).tolist())
Outt3.append(np.asarray(dec_mesh3.vertices).tolist())
 
 

    
#o3d.visualization.draw_geometries([segments[i] for i in range(max_plane_idx)]+[rest])
#
OUT = Outt2,Outt3
# ----------------------------------------
code_block = CodeBlock(c=point_Cloud) { c; }
code_block_2 = CodeBlock(s=code_block) { s[1][0][0]; }
transpose = List.Transpose(lists=code_block_2)
code_block_3 = CodeBlock(s=transpose) { s[2]; }
code_block_4 = CodeBlock { 0; }
code_block_5 = CodeBlock(s=code_block, i=code_block_4) { s[1][i]; }
transpose_2 = List.Transpose(lists=code_block_5)
code_block_6 = CodeBlock(s=transpose_2) { s[0]; }
code_block_7 = CodeBlock(s=transpose_2) { s[1]; }
code_block_8 = CodeBlock(s=transpose_2) { s[2]; }
byCoordinates = Point.ByCoordinates(x=code_block_6, y=code_block_7, z=code_block_8)
code_block_9 = CodeBlock(s=transpose) { s[0]; }
code_block_10 = CodeBlock(x=code_block_9) { -x; }
code_block_11 = CodeBlock(s=transpose) { s[1]; }
code_block_12 = CodeBlock(y=code_block_11) { -y; }
translate = Geometry.Translate(geometry=byCoordinates, xTranslation=code_block_10, yTranslation=code_block_12)
code_block_13 = CodeBlock(s=code_block, i=code_block_4) { s[0][i]; }
transpose_3 = List.Transpose(lists=code_block_13)
code_block_14 = CodeBlock(s=transpose_3) { s[0]; }
code_block_15 = CodeBlock(s=transpose_3) { s[1]; }
code_block_16 = CodeBlock(s=transpose_3) { s[2]; }
byIndices = IndexGroup.ByIndices(a=code_block_14, b=code_block_15, c=code_block_16)
byPointsFaceIndices = Mesh.ByPointsFaceIndices(vertexPositions=translate, indices=byIndices)
categories = Categories("OST_GenericModel")
materials = Material()  # nothing selected
code_block_17 = CodeBlock { "df"; }
code_block_18 = CodeBlock(i=code_block_4) { i; }
code_block_19 = CodeBlock(s=code_block_18) { s; }
string_from_object = FromObject(object=code_block_19)
add = code_block_17 + string_from_object
byMesh = DirectShape.ByMesh(mesh=byPointsFaceIndices, category=categories, material=materials, name=add)
code_block_20 = CodeBlock { 0..15; }
add_2 = code_block_17 + string_from_object
