# Dynamo graph Pointcloud Plane Detection using RANSAC.dyn (Dynamo 2.10.0.3455)

# group: Reading a CSV file generated from CloudCompare for Pointcloud Point XYZs
file_path = Filename("C:\Users\ewano\Downloads\Test3.csv")
code_block = CodeBlock { true; }
importCSV = Data.ImportCSV(filePath=file_path, transpose=code_block)
code_block_2 = CodeBlock { 3; }
takeItems = List.TakeItems(list=importCSV@L2, amount=code_block_2)

# group: Inputs
code_block_3 = CodeBlock(input_points_list=takeItems)
# ---------- code_block_3.designscript (2 lines) ----------
//# Input points list in [[x,y,z],[x,y,z]] formated floats.
input_points_list;
# ----------------------------------------
code_block_4 = CodeBlock()
# ---------- code_block_4.designscript (3 lines) ----------
//# The number of planes to attempt
//to find within the point cloud
8;
# ----------------------------------------

# group: RANSAC 3D Plane Detection
py_ransac = Python(IN[0]=code_block_3, IN[1]=code_block_4)  # CPython3
# ---------- py_ransac.python (133 lines) ----------
"""
Important! This code will only work with Dynamo versions
that are able to run cPython3 and have the following additional 
python packages installed.

Packages required:
numpy

"""

import random
import numpy as np
import clr

clr.AddReference('ProtoGeometry')
from Autodesk.DesignScript.Geometry import *

# Create numpy array from point xyz list
def XYZtoArray(x,y,z):
    return np.array([x,y,z],dtype=float)
    
## Remove item at index
def rem(l, id_to_del):
    somelist = [i for j, i in enumerate(l) if j not in id_to_del]
    return somelist    

class RANSAC_3D_Planes:
    """
    This implementation of Random sample consensus (RANSAC) is an iterative method to estimate planes from 3D pointcloud data.
    """

    def __init__(self):
        self.inliers = []
        self.equation = []

    def fit_plane(self, pts, thresh=0.05, minPoints=100, maxIter=1000):
        """
        Find the best plane.
        
        Inputs:
        pts = 3D point cloud as a `np.array (N,3)`.
        thresh = Threshold distance from the plane which is considered inlier.
        maxIter = Number of maximum iteration which RANSAC will loop over.
         """
        n_points = pts.shape[0]
        best_eq = []
        best_inliers = []

        for it in range(maxIter):

            # Samples 3 random points
            id_samples = random.sample(range(0, n_points), 3)
            pt_samples = pts[id_samples]

            # Find the plane equation described by those 3 points
            # We find first 2 vectors that are part of this plane
            # A = pt2 - pt1
            # B = pt3 - pt1

            vecA = pt_samples[1, :] - pt_samples[0, :]
            vecB = pt_samples[2, :] - pt_samples[0, :]

            # Compute the cross product of vecA and vecB to get vecC which is normal to the plane
            vecC = np.cross(vecA, vecB)
                        
            # The plane equation will be vecC[0]*x + vecC[1]*y + vecC[0]*z = -k
            # We have to use a point to find k
            vecC = vecC / np.linalg.norm(vecC)
            k = -np.sum(np.multiply(vecC, pt_samples[1, :]))
            plane_eq = [vecC[0], vecC[1], vecC[2], k]

            # Distance from a point to a plane
            pt_id_inliers = [] 
            dist_pt = (
                plane_eq[0] * pts[:, 0] + plane_eq[1] * pts[:, 1] + plane_eq[2] * pts[:, 2] + plane_eq[3]
            ) / np.sqrt(plane_eq[0] ** 2 + plane_eq[1] ** 2 + plane_eq[2] ** 2)

            # Select indexes where distance is biggers than the threshold
            pt_id_inliers = np.where(np.abs(dist_pt) <= thresh)[0]
            if len(pt_id_inliers) > len(best_inliers):
                best_eq = plane_eq
                best_inliers = pt_id_inliers
            self.inliers = best_inliers
            self.equation = best_eq

        return self.inliers

# Input points list in [[x,y,z],[x,y,z]] formated floats.
points = IN[0]

points_list = []

result = []

# The number of planes to attempt to find
max_iter = IN[1]

# Main Loop
for m in range(max_iter):
   
    points_list = []
    
    # Format input lists
    for p in points:
        points_list.append(XYZtoArray(p[0],p[1],p[2]))
    pArray = np.array(points_list)
    
    pts_found = 0
    # Find best planes
    ransac = RANSAC_3D_Planes()
    best_inliers = ransac.fit_plane(pArray, 0.01)
    
    plane_pts = []
    
    # Remove plane pts from point list
    points_list.clear()
    remaining_pts = rem(points,best_inliers)    
    
    # Create Points from array pts
    for b in best_inliers:
        item = points[b]
        pts_found = + 1
        pt = Point.ByCoordinates(item[0],item[1],item[2])
        
        plane_pts.append(pt)
    
    # Reset points list with plane_pts removed
    points = remaining_pts
    
    # Add plane pts to output
    result.append(plane_pts)
    
OUT = result
# ----------------------------------------

# group: Plane Points
code_block_5 = CodeBlock(result=py_ransac)
# ---------- code_block_5.designscript (2 lines) ----------
//Points sorted into planes
result;
# ----------------------------------------

# group: Visualize Plane Points with Color (Optional)
code_block_6 = CodeBlock()
# ---------- code_block_6.designscript (2 lines) ----------
[Color.ByARGB(255,0,255,0),
Color.ByARGB(255,0,0,255)];
# ----------------------------------------
code_block_7 = CodeBlock(n=code_block_4) { 0..1..1/n; }
color_range = ColorRange(colors=code_block_6, value=code_block_7)  # unwired: indices
byGeometryColor = Modifiers.GeometryColor.ByGeometryColor(geometry=code_block_5, color=color_range)
