# Dynamo graph Random_Family_Placement.dyn (Dynamo 2.13.1.3887)
# packages: Landform 2021.1.25

family_types = FamilyTypes("RPC Tree - Deciduous:Schumard Oak - 30'")  # graph input
family_types_2 = FamilyTypes("RPC Tree - Deciduous:Lombardy Poplar - 40'")  # graph input
list_create = List.Create(item0=family_types, item1=family_types_2)
code_block = CodeBlock { 200; }
select_model_lines = DSModelElementsSelection()  # 24 picked in the model; graph input
geometry = Element.Geometry(element=select_model_lines)
code_block_2 = CodeBlock { 0; }
randomActual = Custom[Point.RandomActual](amount=code_block, curves=geometry, tolerance=code_block_2)  # package Landform
number_slider = DoubleSlider(0.4, range=0..1 step 0.01)  # graph input
number_slider_2 = DoubleSlider(0.35, range=0..1 step 0.01)  # graph input
list_create_2 = List.Create(item0=number_slider, item1=number_slider_2)
percentage = Custom[FamilyInstance.Percentage](familyTypes=list_create, points=randomActual, percent=list_create_2)  # package Landform
randomRotation = Custom[FamilyInstance.RandomRotation](familyInstance=percentage)  # package Landform
