# Dynamo graph VDS_DWG_to_Section.dyn (Dynamo 2.16.1.2727)
# packages: WombatDynamo 1.3.2, Genius Loci 2022.9.16, bimorphNodes 4.2.4

directory_path = Directory("C:\Users\peter\Downloads\dwgtest")  # graph input
views = Views("Section 21")  # graph input
name = Element.Name(element=views)
code_block = CodeBlock { ".dwg"; }
add = name + code_block
exportAsDWG = WombatDynamo.IO.ExportAsDWG(directory=directory_path, filename=add, viewsToExport=views)
add_2 = exportAsDWG + code_block
enumerate_dwg_import_options = Custom[Enumerate DWG import options]()  # package Genius Loci; Enumerate Color mode, Type of Placement and Type of Unit. Works with the "Link DWG" and "Import DWG" nodes.
code_block_2 = CodeBlock(x=enumerate_dwg_import_options.Colormode) { x[2]; }
code_block_3 = CodeBlock(x=enumerate_dwg_import_options.Placement) { x[1]; }
code_block_4 = CodeBlock(x=enumerate_dwg_import_options.Unit) { x[0]; }
link_dwg = Custom[Link DWG](Filepaths=add_2, views=views, Colormode=code_block_2, Placement=code_block_3, unit=code_block_4)  # package Genius Loci; Link DWGs in views with options. Use with the Enumerate DWG import options node. Based on a archilab's script.
detailCurvesFromCADLayers = CAD.DetailCurvesFromCADLayers(importInstance=link_dwg.ImportInstance, view=link_dwg.Views)
