# Dynamo graph VDS_Export_DWG_to_Detail_Lines.dyn "VDS_Export_DWG" (Dynamo 2.16.1.2727)
# packages: WombatDynamo 1.3.2, Genius Loci 2022.9.16, bimorphNodes 4.2.4

directory_path = Directory("C:\Users\peter\Downloads\dwgtest")  # graph input
drafting_view_name = StringInput("test2344")  # graph input
views = Views("Section 2")  # graph input
exportAsDWG = WombatDynamo.IO.ExportAsDWG(directory=directory_path, filename=drafting_view_name, viewsToExport=views)
code_block = CodeBlock { ".dwg"; }
add = exportAsDWG + code_block
byName = DraftingView.ByName(name=drafting_view_name)
enumerate_dwg_import_options = Custom[Enumerate DWG import options]()  # package Genius Loci; Enumerate Color mode, Type of Placement and Type of Unit. Works with the "Link DWG" and "Import DWG" nodes.
code_block_2 = CodeBlock(x=enumerate_dwg_import_options.Colormode) { x[2]; }
code_block_3 = CodeBlock(x=enumerate_dwg_import_options.Placement) { x[1]; }
code_block_4 = CodeBlock(x=enumerate_dwg_import_options.Unit) { x[0]; }
link_dwg = Custom[Link DWG](Filepaths=add, views=byName, Colormode=code_block_2, Placement=code_block_3, unit=code_block_4)  # package Genius Loci; Link DWGs in views with options. Use with the Enumerate DWG import options node. Based on a archilab's script.
detailCurvesFromCADLayers = CAD.DetailCurvesFromCADLayers(importInstance=link_dwg.ImportInstance, view=link_dwg.Views)
