# Dynamo graph VDS_Sheet_Duplicate_Rename.dyn "Sheet_Duplicate_Rename" (Dynamo 2.16.1.2727)
# packages: bimorphNodes 4.2.4

sheets = Sheets("testsheet")  # graph input
run_boolean = BoolSelector(true)  # graph input
boolean = BoolSelector(true)
code_block = CodeBlock { 2; }
suffix = StringInput("2")
duplicate = Revit.Sheet.Duplicate(sheets=sheets, run=run_boolean, duplicateWithViews=boolean, duplicateOption=code_block, suffix=suffix)
