# Dynamo graph change_family_type_complete.dyn (Dynamo 2.12.0.5650)
# packages: archi-lab.net 2022.210.2522, Clockwork for Dynamo 2.x 2.3.0

categories = Categories("OST_Furniture")
byCategory = archilab.Revit.Selection.Select.ByCategory(category=categories)
code_block = CodeBlock { "Family"; }
categories_2 = Categories("OST_Furniture")
all_families_of_category = Custom[All Families Of Category](category=categories_2)  # package Clockwork for Dynamo 2.x; Gets all famiies of a given category in the model (does *not *work for system families)
types = Family.Types(family=all_families_of_category)
code_block_2 = CodeBlock { 0; }
getItemAtIndex = List.GetItemAtIndex(list=types@L2, index=code_block_2)
setParameterByName = Element.SetParameterByName(element=byCategory, parameterName=code_block, value=getItemAtIndex)
