# Dynamo graph load_and_place_family.dyn (Dynamo 2.13.1.3887)
# packages: Orchid 213.0.1.8227, Landform 2021.1.25

directory_path = Directory("C:\Users\peter\Dropbox\Revit\Drawing Files\2_VDS_BIM_MGMT\FM_MFR_Manufacturer_Families\Gaggenau")  # graph input
directory_from_path = DirectoryObject(path=directory_path)
code_block = CodeBlock { "*.rfa"; }
code_block_2 = CodeBlock { false; }
getDirectoryContents = FileSystem.GetDirectoryContents(directory=directory_from_path, searchString=code_block, includeSubdirectories=code_block_2)
loadFamily = Orchid.RevitProject.Common.Document.LoadFamily(family=getDirectoryContents.files)
types = Family.Types(family=loadFamily)
code_block_3 = CodeBlock { 0; }
getItemAtIndex = List.GetItemAtIndex(list=types@L2, index=code_block_3)
select_model_line = DSModelElementSelection()  # 1 picked in the model; graph input
getLocation = Element.GetLocation(element=select_model_line)
count = List.Count(list=getDirectoryContents.files)
dividePoints = Custom[Curve.DividePoints](curve=getLocation, divisions=count)  # package Landform; Get the (start) points along an equally divided curve.
byPoint = FamilyInstance.ByPoint(familyType=getItemAtIndex, point=dividePoints)
