# Dynamo graph load_families_from_directory.dyn (Dynamo 2.16.1.2727)

directory_path = Directory("No file selected.")
loadFamily = Custom[Document.LoadFamily](path=directory_path)  # A very crude implementation of family loading. Will *not* reload an already loaded family of the same name.
watch = Watch(loadFamily.familyTypes)
watch_2 = Watch(loadFamily.success)
