# Dynamo graph randomized_tree_placement_to_topo_non_adaptive_in_progress.dyn (Dynamo 2.12.0.5650)
# packages: Landform 2021.1.25

family_types = FamilyTypes("yew 26768:yew 26768")
family_types_2 = FamilyTypes("shumard oak fall 24476:shumard oak fall 24476")
family_types_3 = FamilyTypes("scarletoak 26184:scarletoak 26184")
list_create = List.Create(item0=family_types_2, item1=family_types_3)
code_block = CodeBlock { 200; }
select_model_elements = DSModelElementsSelection()  # 24 picked in the model
geometry = Element.Geometry(element=select_model_elements)
code_block_2 = CodeBlock { 0; }
randomActual = Custom[Point.RandomActual](amount=code_block, curves=geometry, tolerance=code_block_2)  # package Landform; Creates the specified amount of random points within a set boundary curves. Tolerance specifies the minimum distance between points.
code_block_3 = CodeBlock { 0.45; 0.3; }
list_create_2 = List.Create(item0=code_block_3.out0, item1=code_block_3.out1)
percentage = Custom[FamilyInstance.Percentage](familyTypes=list_create, points=randomActual, percent=list_create_2)  # package Landform; Place familiy instances by point from a list of multiple family types and percentages. Last percentage is automatically calculated.
randomRotation = Custom[FamilyInstance.RandomRotation](familyInstance=percentage)  # package Landform; Rotates the angle of the family instance a random amount (between 0 and 360).
